# Dynamo graph PropertySetToText_v3.0.dyn "Dynamo_PropertySetToText_v3.0" (Dynamo 3.0.3.7597)
# author: Michael Gonzalez
# packages: Civil3DToolkit 1.1.32

code_block = CodeBlock { 0; }
code_block_2 = CodeBlock { 1; }
code_block_3 = CodeBlock { 2; }

# group: Tag offset
x_offset = DoubleInput(0)  # graph input
y_offset = DoubleInput(-2)  # graph input

# group: GIS PROPERTY SET TO TAG
gis_property_set_to_tag_extended = StringInput("MATERIAL")  # "GIS Property Set to Tag[Extended Data]"; graph input

# group: Type Text Layer
layer_to_be_assigned_to_tag = StringInput("269")  # graph input

# group: Select Text Size
text_size = DoubleSlider(0.25, range=0..25 step 0.1)  # graph input

# group: Getting Feature Lines form Site
current = Autodesk.AutoCAD.DynamoNodes.Document.Current()
code_block_4 = CodeBlock { 2; }
code_block_5 = CodeBlock { 1; }

# group: Assign Feature line to site!!!
getSites = Autodesk.Civil.DynamoNodes.LandDevelopment.Site.GetSites(document=current)

# group: Select list index
getFeatureLines = Autodesk.Civil.DynamoNodes.LandDevelopment.Site.GetFeatureLines(site=getSites)
site_number = DoubleInput(3)  # graph input
network_site_number = Watch(getFeatureLines)  # graph output

# group (continued): Getting Feature Lines form Site
getItemAtIndex = List.GetItemAtIndex(list=getFeatureLines, index=site_number)
propertySets = Autodesk.AutoCAD.DynamoNodes.Object.PropertySets(object=getItemAtIndex)
propertyByName = Autodesk.AutoCAD.DynamoNodes.PropertySet.PropertyByName(propertySet=propertySets, name=gis_property_set_to_tag_extended)
flatten = List.Flatten(list=propertyByName, amount=code_block_5)
value = Autodesk.AutoCAD.DynamoNodes.Property.Value(property=flatten)

# group: CHECK POINT Feature line start and end points
getAllPoints = Autodesk.Civil.DynamoNodes.LandDevelopment.FeatureLine.GetAllPoints(featureLine=getItemAtIndex)

# group (continued): Getting Feature Lines form Site
flatten_2 = List.Flatten(list=getAllPoints, amount=code_block_4)

getItemAtIndex_2 = List.GetItemAtIndex(list=getAllPoints@L2, index=code_block)
X = Point.X(point=getItemAtIndex_2)
getItemAtIndex_3 = List.GetItemAtIndex(list=getAllPoints@L2, index=code_block_2)
X_2 = Point.X(point=getItemAtIndex_3)
add = X + X_2
div = add / code_block_3
add_2 = div + x_offset

# group: y coordinate
Y = Point.Y(point=getItemAtIndex_2)
Y_2 = Point.Y(point=getItemAtIndex_3)
add_3 = Y + Y_2
code_block_6 = CodeBlock { 2; }
div_2 = add_3 / code_block_6

add_4 = div_2 + y_offset

# group: TAG STYLE
code_block_7 = CodeBlock { 0; }
byCoordinates = Point.ByCoordinates(x=add_2, y=add_4, z=code_block_7)
string_from_object = FromObject(object=value)
byPointTextRotation = Autodesk.AutoCAD.DynamoNodes.Temp.MText.ByPointTextRotation(location=byCoordinates, text=string_from_object, layer=layer_to_be_assigned_to_tag, height=text_size)
